# Grasshopper definition algorithm.gh (Grasshopper 1.0.7)
# plug-ins: Shortest Walk in Gh

# ---- group: closed curves
crv = Curve([<curve referenced from the Rhino model> x5000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])  # disabled
c_script = CSharpScript(curves=crv)  # -> out, closedCurves; inputs curves: list of Curve; disabled
# ---------- c_script: C# ----------
    // List to store closed curves
    List<Curve> closedCurvesList = new List<Curve>();

    // Iterate through each curve and check if it is closed
    foreach (Curve curve in curves)
    {
      if (curve.IsClosed)
      {
        closedCurvesList.Add(curve);
      }
    }

    // Output the list of closed curves
    closedCurves = closedCurvesList;
# ---------- end c_script ----------
crv_2 = Curve(c_script.closedCurves)  # disabled
panel = Panel(c_script.out)  # disabled

# ---- group: Intersect
crv_3 = Curve([<curve referenced from the Rhino model> x5000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])  # disabled
c_script_2 = CSharpScript(Curves=crv_3)  # -> out, Segments; inputs Curves: list of Curve; disabled
# ---------- c_script_2: C# ----------
    // List to store all the resulting curve segments
    List<Curve> allSegments = new List<Curve>();
    
    // Dictionary to store the intersection parameters for each curve
    Dictionary<Curve, List<double>> curveIntersections = new Dictionary<Curve, List<double>>();

    // Initialize the dictionary with empty lists for each curve
    foreach (var curve in Curves)
    {
      curveIntersections[curve] = new List<double>();
    }

    // Find intersections between each pair of curves
    for (int i = 0; i < Curves.Count; i++)
    {
      Curve curveA = Curves[i];
      for (int j = i + 1; j < Curves.Count; j++)
      {
        Curve curveB = Curves[j];

        // Find the intersection points between curveA and curveB
        var intersections = Rhino.Geometry.Intersect.Intersection.CurveCurve(curveA, curveB, 0.001, 0.001);
        foreach (var intersection in intersections)
        {
          // Add the intersection parameter to the corresponding curve's list
          curveIntersections[curveA].Add(intersection.ParameterA);
          curveIntersections[curveB].Add(intersection.ParameterB);
        }
      }
    }

    // Split each curve at the intersection points
    foreach (var kvp in curveIntersections)
    {
      Curve curve = kvp.Key;
      List<double> parameters = kvp.Value;
      
      if (parameters.Count > 0)
      {
        // Sort the parameters to ensure correct splitting order
        parameters.Sort();
        
        // Split the curve at the intersection points
        var segments = curve.Split(parameters);
        foreach (var segment in segments)
        {
          allSegments.Add(segment);
        }
      }
      else
      {
        // If no intersections were found, keep the original curve
        allSegments.Add(curve);
      }
    }

    // Output all the curve segments
    Segments = allSegments;
# ---------- end c_script_2 ----------
crv_4 = Curve(c_script_2.Segments)  # disabled

# ---- group: component 0: data processing
crv_5 = Curve([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])
col = Colour(RGB(138, 138, 138))
pt = Point([<point referenced from the Rhino model> x511])
crv_6 = Curve([<curve referenced from the Rhino model> x485])
crv_7 = Curve([<curve referenced from the Rhino model> x65])
srf = Surface([<surface referenced from the Rhino model> x14])
crv_8 = Curve([<curve referenced from the Rhino model> x455])
crv_9 = Curve([<curve referenced from the Rhino model> x440])
srf_2 = Surface([<surface referenced from the Rhino model> x4])
preview = CustomPreview(Geometry=crv_5, Material=col)
component_0_data_processing = CSharpScript(
    roadSegmentID="384",
    curves=crv_5,
    layerName="road",
    filePath="E:\0141thesis\mapping\output.csv",
    layer1="crime",
    layer2="bench",
    layer3="step",
    layer4="ramp",
    layer5="traffic_light",
    layer6="no_lighting",
    layer7="pothole",
    layer8="restaurant",
    layer9="bar/pub",
    layer10="cafe",
    layer11="bakery",
    layer12="dessert_store",
    layer13="food_stall",
    layer14="market",
    layer15="square",
    layer16="greenery",
    waterwayLayer="waterway",
    trafficLightPoints=pt,
    stepCurves=crv_6,
    rampCurves=crv_8,
    noLightingCurves=crv_9,
    potholeCurves=crv_7,
    noLightingSurfaces=srf,
    potholeSurfaces=srf_2)  # -> out, roadSegment, waterwaySegments, greenerySegments, distanceToWaterway; inputs roadSegmentID: Int32, curves: list of Curve, layerName: String, filePath: String, layer1: String, layer2: String, layer3: String, layer4: String, layer5: String, layer6: String, layer7: String, layer8: String, layer9: String, layer10: String, layer11: String, layer12: String, layer13: String, layer14: String, layer15: String, layer16: String, waterwayLayer: String, trafficLightPoints: list of Point3d, stepCurves: list of Curve, rampCurves: list of Curve, noLightingCurves: list of Curve, potholeCurves: list of Curve, noLightingSurfaces: list of Brep, potholeSurfaces: list of Brep; disabled
# ---------- component_0_data_processing: C# usings ----------
using Rhino.DocObjects;
using System.IO;
# ---------- component_0_data_processing: C# ----------
    bool debug = true; // Set to true to enable detailed debugging output
    double offsetDistance = 20.0; // Distance to offset the waterway surface

    string[] allLayerNames = { layer1, layer2, layer3, layer4, layer5, layer6, layer7, layer8, layer9, layer10, layer11, layer12, layer13, layer14 };
    string[] specialLayerNames = { layer15, layer16, waterwayLayer };

    var roadSegmentsDict = AssignRoadSegmentIDs(curves);
    var objectsByLayer = GetObjectsByLayerNames(allLayerNames);

    var specialObjectsByLayer = GetObjectsByLayerNames(specialLayerNames);
    var squareObjects = specialObjectsByLayer[layer15];
    var greeneryObjects = specialObjectsByLayer[layer16];
    var waterwayObjects = specialObjectsByLayer[waterwayLayer];

    StoreIDsInRhinoObjects(roadSegmentsDict);
    var csvLines = CreateCSVLines(roadSegmentsDict, objectsByLayer, squareObjects, greeneryObjects, waterwayObjects, trafficLightPoints, stepCurves, rampCurves, noLightingCurves, potholeCurves, noLightingSurfaces, potholeSurfaces, offsetDistance);
    SaveCSVFile(csvLines, filePath);

    string segmentID = roadSegmentID.ToString("D6");
    if (roadSegmentsDict.ContainsKey(segmentID))
    {
      roadSegment = roadSegmentsDict[segmentID];
      double distance = CalculateDistanceToOffsetWaterway(roadSegmentsDict[segmentID], waterwayObjects, offsetDistance, debug);
      distanceToWaterway = distance <= 20 ? (double?) distance : null; // Only output distance if within 20 meters

      // Debugging output
      if (debug)
      {
        Print(string.Format("Road Segment ID: {0}, Distance to Waterway: {1}", segmentID, distanceToWaterway));
      }
    }
    else
    {
      roadSegment = null;
      distanceToWaterway = null;

      // Debugging output
      if (debug)
      {
        Print(string.Format("Road Segment ID: {0} not found.", segmentID));
      }
    }

    var waterwaySegmentList = new List<Curve>();
    var waterwayCounts = CalculateWaterwayCounts(roadSegmentsDict, waterwayObjects, offsetDistance);
    foreach (var road in roadSegmentsDict)
    {
      string id = road.Key;
      if (waterwayCounts.ContainsKey(id) && waterwayCounts[id] > 0)
      {
        waterwaySegmentList.Add(road.Value);
      }
    }
    waterwaySegments = waterwaySegmentList;

    var greenerySegmentList = new List<Curve>();
    var greeneryCounts = CalculateSquareAndGreeneryCounts(roadSegmentsDict, greeneryObjects);
    foreach (var road in roadSegmentsDict)
    {
      string id = road.Key;
      if (greeneryCounts.ContainsKey(id) && greeneryCounts[id] > 0)
      {
        greenerySegmentList.Add(road.Value);
      }
    }
    greenerySegments = greenerySegmentList;
# ---------- component_0_data_processing: C# additional code ----------
  /// Calculate counts for No_lighting and pothole.
  private void CalculateNoLightingAndPotholeCounts(Dictionary<string, Curve> roadSegments, List<Curve> noLightingCurves, List<Curve> potholeCurves, List<Brep> noLightingSurfaces, List<Brep> potholeSurfaces, out Dictionary<string, int> noLightingCounts, out Dictionary<string, int> potholeCounts)
  {
    noLightingCounts = new Dictionary<string, int>();
    potholeCounts = new Dictionary<string, int>();

    // Initialize all segment counts to 0
    foreach (var road in roadSegments)
    {
      noLightingCounts[road.Key] = 0;
      potholeCounts[road.Key] = 0;
    }

    // Check for no lighting curves
    foreach (var noLightingCurve in noLightingCurves)
    {
      Point3d startPoint = noLightingCurve.PointAtStart;
      Point3d endPoint = noLightingCurve.PointAtEnd;

      foreach (var road in roadSegments)
      {
        string id = road.Key;
        if (noLightingCounts[id] == 0 && (IsPointOnRoadSegment(road.Value, startPoint) || IsPointOnRoadSegment(road.Value, endPoint)))
        {
          noLightingCounts[id] = 1;
        }
      }
    }

    // Check for pothole curves
    foreach (var potholeCurve in potholeCurves)
    {
      Point3d startPoint = potholeCurve.PointAtStart;
      Point3d endPoint = potholeCurve.PointAtEnd;

      foreach (var road in roadSegments)
      {
        string id = road.Key;
        if (potholeCounts[id] == 0 && (IsPointOnRoadSegment(road.Value, startPoint) || IsPointOnRoadSegment(road.Value, endPoint)))
        {
          potholeCounts[id] = 1;
        }
      }
    }

    // Check for no lighting surfaces
    foreach (var noLightingSurface in noLightingSurfaces)
    {
      foreach (var road in roadSegments)
      {
        string id = road.Key;
        if (noLightingCounts[id] == 0 && IsCurveInsideSurface(road.Value, noLightingSurface))
        {
          noLightingCounts[id] = 1;
        }
      }
    }

    // Check for pothole surfaces
    foreach (var potholeSurface in potholeSurfaces)
    {
      foreach (var road in roadSegments)
      {
        string id = road.Key;
        if (potholeCounts[id] == 0 && IsCurveInsideSurface(road.Value, potholeSurface))
        {
          potholeCounts[id] = 1;
        }
      }
    }
  }

  /// Check if a point is on a road segment
  private bool IsPointOnRoadSegment(Curve roadCurve, Point3d point)
  {
    double t;
    if (roadCurve.ClosestPoint(point, out t))
    {
      Point3d closestPoint = roadCurve.PointAt(t);
      return point.DistanceTo(closestPoint) < 0.01; // Use a small tolerance for point on curve check
    }
    return false;
  }








  /// Check if a curve is inside a surface
  private bool IsCurveInsideSurface(Curve roadCurve, Brep surface)
  {
    var tolerance = RhinoDoc.ActiveDoc.ModelAbsoluteTolerance;
    var curveBreps = Brep.CreatePlanarBreps(roadCurve, tolerance);
    if (curveBreps == null || curveBreps.Length == 0) return false;

    foreach (var face in surface.Faces)
    {
      foreach (var curveBrep in curveBreps)
      {
        var points = curveBrep.DuplicateVertices();
        bool allPointsInside = true;
        foreach (var point in points)
        {
          if (!IsPointInSurface(face, point, tolerance))
          {
            allPointsInside = false;
            break;
          }
        }
        if (allPointsInside)
        {
          return true;
        }
      }
    }
    return false;
  }

  /// Check if a point is inside a surface face
  private bool IsPointInSurface(BrepFace face, Point3d point, double tolerance)
  {
    double u, v;
    var success = face.ClosestPoint(point, out u, out v);
    if (!success) return false;

    if (point.DistanceTo(face.PointAt(u, v)) <= tolerance)
    {
      return true;
    }
    return false;
  }














  /// Calculate counts for step and ramp.
  private void CalculateStepAndRampCounts(Dictionary<string, Curve> roadSegments, List<Curve> stepCurves, List<Curve> rampCurves, out Dictionary<string, int> stepCounts, out Dictionary<string, int> rampCounts)
  {
    stepCounts = new Dictionary<string, int>();
    rampCounts = new Dictionary<string, int>();

    // Initialize all segment counts to 0
    foreach (var road in roadSegments)
    {
      stepCounts[road.Key] = 0;
      rampCounts[road.Key] = 0;
    }

    // Check for step curves
    foreach (var stepCurve in stepCurves)
    {
      Point3d startPoint = stepCurve.PointAtStart;
      Point3d endPoint = stepCurve.PointAtEnd;

      foreach (var road in roadSegments)
      {
        string id = road.Key;
        if (stepCounts[id] == 0 && (IsPointOnRoadSegment(road.Value, startPoint) || IsPointOnRoadSegment(road.Value, endPoint)))
        {
          stepCounts[id] = 1;
        }
      }
    }

    // Check for ramp curves
    foreach (var rampCurve in rampCurves)
    {
      Point3d startPoint = rampCurve.PointAtStart;
      Point3d endPoint = rampCurve.PointAtEnd;

      foreach (var road in roadSegments)
      {
        string id = road.Key;
        if (rampCounts[id] == 0 && (IsPointOnRoadSegment(road.Value, startPoint) || IsPointOnRoadSegment(road.Value, endPoint)))
        {
          rampCounts[id] = 1;
        }
      }
    }
  }













  /// Calculate counts for traffic lights.
  private Dictionary<string, int> CalculateTrafficLightCounts(Dictionary<string, Curve> roadSegments, List<Point3d> trafficLightPoints)
  {
    var trafficLightCounts = new Dictionary<string, int>();

    // Initialize all segment counts to 0
    foreach (var road in roadSegments)
    {
      trafficLightCounts[road.Key] = 0;
    }

    foreach (var pointLocation in trafficLightPoints)
    {
      double minDistance = Double.MaxValue;
      string closestRoadId = null;

      foreach (var road in roadSegments)
      {
        string id = road.Key;
        Curve curve = road.Value;
        double t;

        // Check the closest point on the curve to the traffic light point
        if (curve.ClosestPoint(pointLocation, out t))
        {
          double distance = curve.PointAt(t).DistanceTo(pointLocation);

          // If the distance is less than the minimum distance found, update the closest road segment
          if (distance < minDistance)
          {
            minDistance = distance;
            closestRoadId = id;
          }
        }
      }

      // If a closest road segment is found and the point is within a reasonable distance, increment the count
      if (closestRoadId != null && minDistance == 0)
      {
        trafficLightCounts[closestRoadId]++;
      }
    }

    return trafficLightCounts;
  }










  /// Extract and offset the boundary of a waterway surface.
  private Brep CreateOffsetSurface(Brep waterwayBrep, double offsetDistance)
  {
    List<Curve> boundaryCurves = new List<Curve>();

    // Extract the boundary curves of the waterway
    foreach (var brepEdge in waterwayBrep.Edges)
    {
      boundaryCurves.Add(brepEdge.DuplicateCurve());
    }

    // Join the boundary curves into a single curve
    Curve[] joinedCurves = Curve.JoinCurves(boundaryCurves);
    if (joinedCurves.Length != 1)
      return null;

    Curve boundaryCurve = joinedCurves[0];

    // Offset the boundary curve
    Curve offsetCurve = boundaryCurve.Offset(Plane.WorldXY, offsetDistance, 0.01, CurveOffsetCornerStyle.Sharp)[0];

    // Create a planar surface from the offset curve
    Brep[] offsetSurfaces = Brep.CreatePlanarBreps(offsetCurve, 0.01);
    if (offsetSurfaces == null || offsetSurfaces.Length == 0)
      return null;

    return offsetSurfaces[0];
  }





  /// Calculate the minimum distance from a curve to an offset waterway surface.
  private double CalculateDistanceToOffsetWaterway(Curve curve, List<GeometryBase> waterwayObjects, double offsetDistance, bool debug = false)
  {
    double minDistance = double.MaxValue;

    foreach (var waterway in waterwayObjects)
    {
      Brep waterwayBrep = waterway as Brep;
      if (waterwayBrep == null)
        continue;

      // Create the offset surface
      Brep offsetSurface = CreateOffsetSurface(waterwayBrep, offsetDistance);
      if (offsetSurface == null)
        continue;

      foreach (var brepFace in offsetSurface.Faces)
      {
        for (double tCurve = 0; tCurve <= 1; tCurve += 0.1) // Increase the step to reduce computation
        {
          Point3d point = curve.PointAtNormalizedLength(tCurve);
          Point3d closestPoint;
          ComponentIndex ci;
          double s, tSurface;
          Vector3d normal;

          if (offsetSurface.ClosestPoint(point, out closestPoint, out ci, out s, out tSurface, 0.1, out normal))
          {
            double distance = point.DistanceTo(closestPoint);
            if (distance < minDistance)
            {
              minDistance = distance;
            }

            // Debugging output
            if (debug)
            {
              Print(string.Format("Curve Point: {0}, Closest Point on Offset Surface: {1}, Distance: {2}", point, closestPoint, distance));
            }

            // Early exit if the distance is within the threshold
            if (minDistance <= 20)
            {
              if (debug)
              {
                Print(string.Format("Early exit - Curve Point: {0}, Closest Point: {1}, Distance: {2}", point, closestPoint, distance));
              }
              return minDistance;
            }
          }
        }
      }
    }

    // Debugging output
    if (debug)
    {
      Print(string.Format("Minimum Distance: {0}", minDistance));
    }

    return minDistance;
  }
















  /// Calculate counts for waterway surfaces.
  private Dictionary<string, int> CalculateWaterwayCounts(Dictionary<string, Curve> roadSegments, List<GeometryBase> waterwayObjects, double offsetDistance)
  {
    Dictionary<string, int> waterwayCounts = new Dictionary<string, int>();

    foreach (var road in roadSegments)
    {
      waterwayCounts[road.Key] = 0;
    }

    foreach (var waterway in waterwayObjects)
    {
      Brep waterwayBrep = waterway as Brep;
      if (waterwayBrep == null)
        continue;

      // Create the offset surface
      Brep offsetSurface = CreateOffsetSurface(waterwayBrep, offsetDistance);
      if (offsetSurface == null)
        continue;

      foreach (var road in roadSegments)
      {
        string id = road.Key;
        Curve curve = road.Value;

        foreach (var brepFace in offsetSurface.Faces)
        {
          for (double tCurve = 0; tCurve <= 1; tCurve += 0.1) // Increase the step to reduce computation
          {
            Point3d point = curve.PointAtNormalizedLength(tCurve);
            Point3d closestPoint;
            ComponentIndex ci;
            double s, tSurface;
            Vector3d normal;

            if (offsetSurface.ClosestPoint(point, out closestPoint, out ci, out s, out tSurface, 0.1, out normal))
            {
              double distance = point.DistanceTo(closestPoint);
              if (distance <= 20)
              {
                waterwayCounts[id] = 1; // Only count once per road segment
                break;
              }
            }
          }
        }
      }
    }

    return waterwayCounts;
  }






  /// Get objects by layer names.
  private Dictionary<string, List<GeometryBase>> GetObjectsByLayerNames(params string[] layerNames)
  {
    var objectsByLayer = new Dictionary<string, List<GeometryBase>>();

    foreach (var layerName in layerNames)
    {
      List<GeometryBase> objects = new List<GeometryBase>();
      Layer layer = RhinoDocument.Layers.FindName(layerName);

      if (layer != null)
      {
        RhinoObject[] rhinoObjects = RhinoDocument.Objects.FindByLayer(layer);
        foreach (var obj in rhinoObjects)
        {
          if (obj.Geometry is Point || obj.Geometry is Brep || obj.Geometry is Curve)
          {
            objects.Add(obj.Geometry);
          }
        }
      }

      objectsByLayer[layerName] = objects;
    }

    return objectsByLayer;
  }




  /// Assign IDs to road segments.

  private Dictionary<string, Curve> AssignRoadSegmentIDs(List<Curve> curves)
  {
    var roadSegments = new Dictionary<string, Curve>();

    // Iterate over all curves and assign a 6-digit ID
    for (int i = 0; i < curves.Count; i++)
    {
      string id = (i + 1).ToString("D6");
      roadSegments.Add(id, curves[i]);
    }

    return roadSegments;
  }


  /// Store IDs in Rhino objects.
  private void StoreIDsInRhinoObjects(Dictionary<string, Curve> roadSegments)
  {
    // Create an RTree to index all curve objects
    RTree rTree = new RTree();
    List<RhinoObject> curveObjects = new List<RhinoObject>();
    Rhino.DocObjects.RhinoObject[] rhinoObjects = RhinoDocument.Objects.FindByObjectType(Rhino.DocObjects.ObjectType.Curve);
    for (int i = 0; i < rhinoObjects.Length; i++)
    {
      var rhinoObject = rhinoObjects[i];
      Curve objCurve = rhinoObject.Geometry as Curve;
      if (objCurve != null)
      {
        BoundingBox bbox = objCurve.GetBoundingBox(true);
        rTree.Insert(bbox, i);
        curveObjects.Add(rhinoObject);
      }
    }

    foreach (var road in roadSegments)
    {
      string newId = road.Key;
      Curve curve = road.Value;

      // Find all objects intersecting with the current curve's bounding box
      BoundingBox curveBbox = curve.GetBoundingBox(true);
      List<int> potentialMatches = new List<int>();
      rTree.Search(curveBbox, (sender, args) => { potentialMatches.Add(args.Id); });

      foreach (int i in potentialMatches)
      {
        RhinoObject rhinoObject = curveObjects[i];
        Curve objCurve = rhinoObject.Geometry as Curve;

        if (objCurve != null && AreCurvesEqual(objCurve, curve))
        {
          // Get the existing ID
          string existingId = rhinoObject.Attributes.GetUserString("RoadSegmentID");

          // Only update if the existing ID is different from the new ID
          if (existingId != newId)
          {
            rhinoObject.Attributes.SetUserString("RoadSegmentID", newId);
            rhinoObject.Attributes.Name = newId;
            rhinoObject.CommitChanges();
          }
          break;
        }
      }
    }
  }

  /// Check if two curves are equal.
  private bool AreCurvesEqual(Curve curve1, Curve curve2)
  {
    NurbsCurve nurbsCurve1 = curve1.ToNurbsCurve();
    NurbsCurve nurbsCurve2 = curve2.ToNurbsCurve();

    if (nurbsCurve1.Points.Count != nurbsCurve2.Points.Count)
    {
      return false;
    }

    for (int i = 0; i < nurbsCurve1.Points.Count; i++)
    {
      if (!nurbsCurve1.Points[i].Location.Equals(nurbsCurve2.Points[i].Location))
      {
        return false;
      }
    }

    return true;
  }

  /// Calculate object counts for each road segment.
  private Dictionary<string, Dictionary<string, int>> CalculateObjectCounts(Dictionary<string, Curve> roadSegments, Dictionary<string, List<GeometryBase>> objectsByLayer)
  {
    var countsBySegment = new Dictionary<string, Dictionary<string, int>>();

    // Initialize all segment counts to 0
    foreach (var road in roadSegments)
    {
      var counts = new Dictionary<string, int>();
      foreach (var layerName in objectsByLayer.Keys)
      {
        counts[layerName] = 0;
      }
      countsBySegment[road.Key] = counts;
    }

    foreach (var layerName in objectsByLayer.Keys)
    {
      foreach (var obj in objectsByLayer[layerName])
      {
        double minDistance = Double.MaxValue;
        string closestRoadId = null;

        foreach (var road in roadSegments)
        {
          string id = road.Key;
          Curve curve = road.Value;

          double distance = Double.MaxValue;
          if (obj is Point)
          {
            Point point = (Point) obj;
            Point3d pointLocation = point.Location;
            double t;
            if (curve.ClosestPoint(pointLocation, out t))
            {
              distance = curve.PointAt(t).DistanceTo(pointLocation);
            }
          }
          else if (obj is Brep)
          {
            Brep brep = (Brep) obj;
            foreach (var brepEdge in brep.Edges)
            {
              Point3d edgePoint = brepEdge.PointAtStart;
              double t;
              if (curve.ClosestPoint(edgePoint, out t))
              {
                double tempDistance = curve.PointAt(t).DistanceTo(edgePoint);
                if (tempDistance < distance)
                {
                  distance = tempDistance;
                }
              }
            }
          }

          if (distance < minDistance)
          {
            minDistance = distance;
            closestRoadId = id;
          }
        }

        if (minDistance <= 30 && closestRoadId != null)
        {
          countsBySegment[closestRoadId][layerName]++;
        }
      }
    }

    return countsBySegment;
  }

  /// Calculate counts for square and greenery surfaces.
  private Dictionary<string, int> CalculateSquareAndGreeneryCounts(Dictionary<string, Curve> roadSegments, List<GeometryBase> surfaceObjects)
  {
    Dictionary<string, int> surfaceCounts = new Dictionary<string, int>();

    foreach (var road in roadSegments)
    {
      surfaceCounts[road.Key] = 0;
    }

    foreach (var surface in surfaceObjects)
    {
      Brep surfaceBrep = surface as Brep;
      if (surfaceBrep == null)
        continue;

      foreach (var road in roadSegments)
      {
        string id = road.Key;
        Curve curve = road.Value;

        if (IsCurveWithinSurface(curve, surfaceBrep) || IsCurveNearSurface(curve, surfaceBrep, 10))
        {
          surfaceCounts[id]++;
        }
      }
    }

    return surfaceCounts;
  }





  /// Check if a curve is within a surface.
  private bool IsCurveWithinSurface(Curve curve, Brep surface)
  {
    foreach (var brepFace in surface.Faces)
    {
      Point3d startPoint, endPoint;
      double u, v;

      if (brepFace.ClosestPoint(curve.PointAtStart, out u, out v))
      {
        startPoint = brepFace.PointAt(u, v);
        if (brepFace.ClosestPoint(curve.PointAtEnd, out u, out v))
        {
          endPoint = brepFace.PointAt(u, v);
          if (surface.IsPointInside(startPoint, RhinoMath.SqrtEpsilon, true) && surface.IsPointInside(endPoint, RhinoMath.SqrtEpsilon, true))
          {
            return true;
          }
        }
      }
    }
    return false;
  }

  /// Check if a curve is near a surface within a specified distance.
  private bool IsCurveNearSurface(Curve curve, Brep surface, double distance)
  {
    var points = GetPointsAlongCurve(curve, 5.0); // Get points along the curve every 5 meters
    int closePointCount = 0; // Counter for points within the distance

    foreach (var point in points)
    {
      foreach (var brepFace in surface.Faces)
      {
        double u, v;
        Point3d closestPoint;

        if (brepFace.ClosestPoint(point, out u, out v))
        {
          closestPoint = brepFace.PointAt(u, v);
          if (point.DistanceTo(closestPoint) <= distance)
          {
            closePointCount++;
            if (closePointCount >= 2) // Check if at least 2 points are within the distance
            {
              return true;
            }
          }
        }
      }
    }

    return false;
  }

  /// Get points along a curve at specified intervals
  private List<Point3d> GetPointsAlongCurve(Curve curve, double interval)
  {
    var points = new List<Point3d>();
    double curveLength = curve.GetLength();
    int numPoints = (int) (curveLength / interval);

    for (int i = 0; i <= numPoints; i++)
    {
      double t;
      curve.LengthParameter(i * interval, out t);
      points.Add(curve.PointAt(t));
    }

    return points;
  }







  /// Create CSV lines with road segment data and object counts.
  private List<string> CreateCSVLines(Dictionary<string, Curve> roadSegments, Dictionary<string, List<GeometryBase>> objectsByLayer, List<GeometryBase> squareObjects, List<GeometryBase> greeneryObjects, List<GeometryBase> waterwayObjects, List<Point3d> trafficLightPoints, List<Curve> stepCurves, List<Curve> rampCurves, List<Curve> noLightingCurves, List<Curve> potholeCurves, List<Brep> noLightingSurfaces, List<Brep> potholeSurfaces, double offsetDistance)
  {
    var csvLines = new List<string>();
    string header = "ID,StartX,StartY,StartZ,EndX,EndY,EndZ";
    foreach (var layerName in objectsByLayer.Keys)
    {
      if (layerName != "traffic_light" && layerName != "step" && layerName != "ramp" && layerName != "no_lighting" && layerName != "pothole") // Skip specific layers as they will be calculated separately
      {
        header += "," + layerName.Replace(" ", "");
      }
    }
    header += ",Square,Greenery,Waterway,Traffic_Light,Step,Ramp,No_Lighting,Pothole";  // Add new columns
    csvLines.Add(header);

    var countsBySegment = CalculateObjectCounts(roadSegments, objectsByLayer);

    // Calculate counts for square and greenery
    var squareCounts = CalculateSquareAndGreeneryCounts(roadSegments, squareObjects);
    var greeneryCounts = CalculateSquareAndGreeneryCounts(roadSegments, greeneryObjects);

    // Calculate counts for waterway using the new logic
    var waterwayCounts = CalculateWaterwayCounts(roadSegments, waterwayObjects, offsetDistance);

    // Calculate counts for traffic lights
    var trafficLightCounts = CalculateTrafficLightCounts(roadSegments, trafficLightPoints);

    // Calculate counts for step and ramp
    Dictionary<string, int> stepCounts, rampCounts;
    CalculateStepAndRampCounts(roadSegments, stepCurves, rampCurves, out stepCounts, out rampCounts);

    // Calculate counts for no lighting and pothole
    Dictionary<string, int> noLightingCounts, potholeCounts;
    CalculateNoLightingAndPotholeCounts(roadSegments, noLightingCurves, potholeCurves, noLightingSurfaces, potholeSurfaces, out noLightingCounts, out potholeCounts);

    foreach (var road in roadSegments)
    {
      string id = road.Key;
      Curve curve = road.Value;
      Point3d start = curve.PointAtStart;
      Point3d end = curve.PointAtEnd;
      string line = String.Format("{0},{1},{2},{3},{4},{5},{6}", id, start.X, start.Y, start.Z, end.X, end.Y, end.Z);
      foreach (var layerName in objectsByLayer.Keys)
      {
        if (layerName != "traffic_light" && layerName != "step" && layerName != "ramp" && layerName != "no_lighting" && layerName != "pothole") // Skip specific layers as they will be calculated separately
        {
          line += String.Format(",{0}", countsBySegment[id][layerName]);
        }
      }
      line += String.Format(",{0},{1},{2},{3},{4},{5},{6},{7}",
        squareCounts.ContainsKey(id) ? squareCounts[id] : 0,
        greeneryCounts.ContainsKey(id) ? greeneryCounts[id] : 0,
        waterwayCounts.ContainsKey(id) ? waterwayCounts[id] : 0,
        trafficLightCounts.ContainsKey(id) ? trafficLightCounts[id] : 0,
        stepCounts.ContainsKey(id) ? stepCounts[id] : 0,
        rampCounts.ContainsKey(id) ? rampCounts[id] : 0,
        noLightingCounts.ContainsKey(id) ? noLightingCounts[id] : 0,
        potholeCounts.ContainsKey(id) ? potholeCounts[id] : 0);  // Add new column data
      csvLines.Add(line);
    }

    return csvLines;
  }













  /// Save CSV file to the specified path.
  private void SaveCSVFile(List<string> csvLines, string filePath)
  {
    try
    {
      File.WriteAllLines(filePath, csvLines);
      Print("CSV file saved successfully.");
    }
    catch (Exception ex)
    {
      // Print error message using variable ex
      Print(String.Format("Error saving CSV file: {0}", ex.Message));
      // Ensure variable ex is used in this scope to suppress warnings
      var _ = ex;
    }
  }
# ---------- end component_0_data_processing ----------
crv_10 = Curve(component_0_data_processing.roadSegment)
crv_11 = Curve(component_0_data_processing.greenerySegments)

# ---- group: component 5: route recommendation
safetydemand = BooleanToggle(False)
weightlossdemand = BooleanToggle(True)
natureenvironmentpreference = BooleanToggle(False)
noviceelderlychildkneeissuepreference = BooleanToggle(False)
challengingroutepreference = BooleanToggle(False)
petaccompanyingpreference = BooleanToggle(False)
morningtravelpreference = BooleanToggle(False)
afternoontravelpreference = BooleanToggle(False)
nighttravelpreference = BooleanToggle(False)
component_5_route_recommendation = CSharpScript(
    update=Toggle(True),
    csv="E:\0141thesis\mapping\Path_Ratings.csv",
    tolerance=Slider(0, range=0..1),
    safetyDemand=safetydemand,
    weightLossDemand=weightlossdemand,
    natureEnvironmentPreference=natureenvironmentpreference,
    noviceElderlyChildKneeIssuePreference=noviceelderlychildkneeissuepreference,
    challengingRoutePreference=challengingroutepreference,
    petAccompanyingPreference=petaccompanyingpreference,
    morningTravelPreference=morningtravelpreference,
    afternoonTravelPreference=afternoontravelpreference,
    nightTravelPreference=nighttravelpreference)  # -> out, pathPreferences, bestPaths; inputs update: Boolean, csv: String, tolerance: Double, safetyDemand: Boolean, weightLossDemand: Boolean, natureEnvironmentPreference: Boolean, noviceElderlyChildKneeIssuePreference: Boolean, challengingRoutePreference: Boolean, petAccompanyingPreference: Boolean, morningTravelPreference: Boolean, afternoonTravelPreference: Boolean, nightTravelPreference: Boolean
# ---------- component_5_route_recommendation: C# usings ----------
using System.IO;
using System.Linq;
# ---------- component_5_route_recommendation: C# ----------
    // If the 'update' flag is not set, do nothing and return
    if (!update) return;

    // Read all lines from the CSV file into a list of strings
    var lines = ReadCsvFile(csv);

    // Define the preferences and their associated conditions for different path indices
    var preferences = DefinePreferences();

    // Calculate the path scores based on the preferences
    var results = CalculatePathScores(lines, preferences);
    var pathPreferencesList = results.Item1;
    var pathScores = results.Item2;

    // Output the list of path preferences
    pathPreferences = pathPreferencesList;

    // Identify which preferences were selected by the user
    var selectedPreferences = GetSelectedPreferences(safetyDemand, weightLossDemand, natureEnvironmentPreference, noviceElderlyChildKneeIssuePreference, challengingRoutePreference, petAccompanyingPreference, morningTravelPreference, afternoonTravelPreference, nightTravelPreference);

    // Calculate the best paths based on the selected preferences and tolerance
    bestPaths = CalculateBestPaths(lines, pathScores, selectedPreferences, tolerance);
# ---------- component_5_route_recommendation: C# additional code ----------
  // Function to read all lines from a CSV file and return them as a list of strings
  private List<string> ReadCsvFile(string csv)
  {
    return new List<string>(File.ReadAllLines(csv));
  }

  // Function to define the preferences and associate them with conditions for evaluating path indices
  private Dictionary<string, Func<Dictionary<string, double>, bool>> DefinePreferences()
  {
    return new Dictionary<string, Func<Dictionary<string, double>, bool>>
      {
        {"Safety Demand", indices => indices["Safety Index"] > indices.Values.Average()},
        {"Weight Loss Demand", indices => indices["Weight Loss Index"] > indices.Values.Average()},
        {"Nature Environment Preference", indices => indices["Blue Index"] > indices.Values.Average() && indices["Green Index"] > indices.Values.Average()},
        {"Novice/Elderly/Child/Knee Issue Preference", indices => indices["Special Care Index"] > indices.Values.Average()},
        {"Challenging Route Preference", indices => indices["Special Care Index"] < indices.Values.Average()},
        {"Pet Accompanying Preference", indices => indices["Green Index"] > indices.Values.Average()},
        {"Morning Travel Preference", indices => indices["Morning Index"] > indices.Values.Average()},
        {"Afternoon Travel Preference", indices => indices["Busyness Index"] < indices.Values.Average()},
        {"Night Travel Preference", indices => indices["Night Index"] > indices.Values.Average()}
        };
  }

  // Function to calculate path scores based on the preferences defined earlier
  private Tuple<List<string>, List<Dictionary<string, double>>> CalculatePathScores(List<string> lines, Dictionary<string, Func<Dictionary<string, double>, bool>> preferences)
  {
    var headers = lines[0].Split(','); // Extract headers from the first line
    var pathPreferencesList = new List<string>();
    var pathScores = new List<Dictionary<string, double>>();

    for (int i = 1; i < lines.Count; i++)
    {
      var values = lines[i].Split(',');
      var pathName = values[0]; // Path name is the first value
      var indices = new Dictionary<string, double>();

      for (int j = 1; j < headers.Length; j++)
      {
        double val;
        if (double.TryParse(values[j], out val))
        {
          indices[headers[j]] = val; // Assign parsed value to the corresponding index
        }
      }

      // Find which preferences match this path's indices
      var matchedPreferences = preferences
        .Where(pref => pref.Value(indices))
        .Select(pref => pref.Key)
        .ToList();

      pathPreferencesList.Add(pathName + ":\n" + string.Join("\n", matchedPreferences));
      pathScores.Add(indices);
    }

    return Tuple.Create(pathPreferencesList, pathScores);
  }

  // Function to determine which preferences were selected by the user
  private List<string> GetSelectedPreferences(bool safetyDemand, bool weightLossDemand, bool natureEnvironmentPreference, bool noviceElderlyChildKneeIssuePreference, bool challengingRoutePreference, bool petAccompanyingPreference, bool morningTravelPreference, bool afternoonTravelPreference, bool nightTravelPreference)
  {
    var selectedPreferences = new List<string>();
    if (safetyDemand) selectedPreferences.Add("Safety Demand");
    if (weightLossDemand) selectedPreferences.Add("Weight Loss Demand");
    if (natureEnvironmentPreference) selectedPreferences.Add("Nature Environment Preference");
    if (noviceElderlyChildKneeIssuePreference) selectedPreferences.Add("Novice/Elderly/Child/Knee Issue Preference");
    if (challengingRoutePreference) selectedPreferences.Add("Challenging Route Preference");
    if (petAccompanyingPreference) selectedPreferences.Add("Pet Accompanying Preference");
    if (morningTravelPreference) selectedPreferences.Add("Morning Travel Preference");
    if (afternoonTravelPreference) selectedPreferences.Add("Afternoon Travel Preference");
    if (nightTravelPreference) selectedPreferences.Add("Night Travel Preference");

    return selectedPreferences;
  }

  // Function to calculate the best paths based on selected preferences and a tolerance level
  private List<string> CalculateBestPaths(List<string> lines, List<Dictionary<string, double>> pathScores, List<string> selectedPreferences, double tolerance)
  {
    var headers = lines[0].Split(','); // Extract headers from the first line
    var bestPathsList = new List<Tuple<string, double>>();

    foreach (var pathScore in pathScores)
    {
      var pathName = lines[pathScores.IndexOf(pathScore) + 1].Split(',')[0]; // Get the path name
      var matchedPreferences = new Dictionary<string, double>();

      foreach (var pref in selectedPreferences)
      {
        double score = 0;
        switch (pref)
        {
          case "Safety Demand":
            score = pathScore["Safety Index"];
            break;
          case "Weight Loss Demand":
            score = pathScore["Weight Loss Index"];
            break;

          case "Nature Environment Preference":
            score = (pathScore["Blue Index"] + pathScore["Green Index"]) / 2;
            break;
          case "Novice/Elderly/Child/Knee Issue Preference":
            score = pathScore["Special Care Index"];
            break;
          case "Challenging Route Preference":
            score = 1 - pathScore["Special Care Index"];
            break;
          case "Pet Accompanying Preference":
            score = pathScore["Green Index"];
            break;
          case "Morning Travel Preference":
            score = pathScore["Morning Index"];
            break;
          case "Afternoon Travel Preference":
            score = 1 - pathScore["Busyness Index"];
            break;
          case "Night Travel Preference":
            score = pathScore["Night Index"];
            break;
        }
        matchedPreferences[pref] = score;
      }

      // Calculate the average score for the path based on matched preferences
      double averageScore = matchedPreferences.Values.Average();
      if (averageScore >= tolerance)
      {
        // Add path to the list of best paths if it meets the tolerance criteria
        bestPathsList.Add(new Tuple<string, double>(pathName + ": " + string.Join(", ", matchedPreferences.Select(kv => kv.Key + " " + (kv.Value * 100).ToString("F0") + "%")), averageScore));
      }
    }

    // Sort the best paths by their average score in descending order
    bestPathsList = bestPathsList.OrderByDescending(item => item.Item2).ToList();

    // Return the best paths as a list of strings
    return bestPathsList.Select(item => item.Item1).ToList();
  }
# ---------- end component_5_route_recommendation ----------
panel_2 = Panel(component_5_route_recommendation.bestPaths)
panel_3 = Panel(component_5_route_recommendation.pathPreferences)

# ---- group: component 4: path rating
component_4_path_rating = CSharpScript(update=Toggle(False), csv="E:\0141thesis\mapping\PathAttributes_updated.csv")  # -> out, A; inputs update: Boolean, csv: String
# ---------- component_4_path_rating: C# ----------
    // If the 'update' flag is not set, do nothing and return
    if (!update) return;

    // Call the encapsulated methods
    var lines = ReadCsvFile(csv);
    var indices = DefineIndices();
    var attributeMinMax = CalculateAttributeMinMax(lines, indices);
    var pathScoresList = CalculatePathScores(lines, indices, attributeMinMax);
    NormalizeScores(pathScoresList, indices);
    string newCsvPath = CreateNewCsvFile(csv, lines, pathScoresList, indices);
    
    // Optionally, you could return or set the newCsvPath in an output variable like this:
    A = newCsvPath;
# ---------- component_4_path_rating: C# additional code ----------
  private List<string> ReadCsvFile(string csv)
  {
    return new List<string>(File.ReadAllLines(csv));
  }

  private Dictionary<string, Dictionary<string, double>> DefineIndices()
  {
    return new Dictionary<string, Dictionary<string, double>>
      {
        {"Safety Index", new Dictionary<string, double> {{"crime", -1}}},
        {"Weight Loss Index", new Dictionary<string, double> {{"Restaurant", -1}, {"Food stall", -1}, {"Bar/pub", -1},
            {"Café", -1}, {"Bakery", -1}, {"Dessert store", -1}, {"market", -0.5}}},
        {"Busyness Index", new Dictionary<string, double> {{"Connectivity", 1}, {"Integration", 1}, {"Choice", 1}}},
        {"Special Care Index", new Dictionary<string, double> {{"step", -1}, {"ramp", -1}, {"pothole", -1}, {"no_lighting", -1},
            {"traffic_light", -0.5}, {"bench", 1}, {"Connectivity", -0.7}, {"Integration", -0.7}, {"Choice", -0.7}}},
        {"Green Index", new Dictionary<string, double> {{"Greenery", 1}, {"Square", 0.8}}},
        {"Blue Index", new Dictionary<string, double> {{"Waterway", 1}}},
        {"Morning Index", new Dictionary<string, double> {{"Café", 1}, {"Bakery", 1}, {"market", 1}}},
        {"Night Index", new Dictionary<string, double> {{"crime", -1}, {"no_lighting", -1}}}
        };
  }

  private Dictionary<string, Tuple<double, double>> CalculateAttributeMinMax(List<string> lines, Dictionary<string, Dictionary<string, double>> indices)
  {
    var headers = lines[0].Split(',');
    var attributeMinMax = new Dictionary<string, Tuple<double, double>>();

    for (int j = 0; j < headers.Length; j++)
    {
      if (j == 0) continue;  // Skip the path name column
      var values = lines.Skip(1).Select(line => double.Parse(line.Split(',')[j])).ToList();
      attributeMinMax[headers[j]] = new Tuple<double, double>(values.Min(), values.Max());
    }

    return attributeMinMax;
  }

  private List<List<double>> CalculatePathScores(List<string> lines, Dictionary<string, Dictionary<string, double>> indices, Dictionary<string, Tuple<double, double>> attributeMinMax)
  {
    var headers = lines[0].Split(',');
    var pathScoresList = new List<List<double>>();

    for (int i = 1; i < lines.Count; i++)
    {
      var values = lines[i].Split(',').ToList();
      var pathScores = new List<double>();

      foreach (var index in indices)
      {
        double score = 0;
        foreach (var attribute in index.Value)
        {
          int idx = Array.IndexOf(headers, attribute.Key);
          if (idx != -1)
          {
            double val;
            if (double.TryParse(values[idx], out val))
            {
              var minMax = attributeMinMax[attribute.Key];
              double normalizedVal = (minMax.Item2 == minMax.Item1) ? 0 : (val - minMax.Item1) / (minMax.Item2 - minMax.Item1);
              if (attribute.Value < 0) normalizedVal = -normalizedVal;  // Invert value if negatively correlated
              score += normalizedVal * Math.Abs(attribute.Value);
            }
          }
        }
        pathScores.Add(double.IsNaN(score) ? 0 : score);  // Avoid NaN values
      }
      pathScoresList.Add(pathScores);
    }

    return pathScoresList;
  }

  private void NormalizeScores(List<List<double>> pathScoresList, Dictionary<string, Dictionary<string, double>> indices)
  {
    for (int j = 0; j < indices.Count; j++)
    {
      var scores = pathScoresList.Select(pathScores => pathScores[j]).ToList();
      double minScore = scores.Min();
      double maxScore = scores.Max();

      for (int i = 0; i < pathScoresList.Count; i++)
      {
        double normalizedScore = (maxScore == minScore) ? 0 : (pathScoresList[i][j] - minScore) / (maxScore - minScore);
        pathScoresList[i][j] = double.IsNaN(normalizedScore) ? 0 : normalizedScore;  // Avoid NaN values
      }
    }
  }

  private string CreateNewCsvFile(string originalCsvPath, List<string> lines, List<List<double>> pathScoresList, Dictionary<string, Dictionary<string, double>> indices)
  {
    var headers = lines[0].Split(',');
    var newLines = new List<string> { "Path," + string.Join(",", indices.Keys) };

    for (int i = 1; i < lines.Count; i++)
    {
      newLines.Add(lines[i].Split(',')[0] + "," + string.Join(",", pathScoresList[i - 1].Select(s => s.ToString("F2"))));
    }

    string newCsvPath = Path.Combine(Path.GetDirectoryName(originalCsvPath), "Path_Ratings" + Path.GetExtension(originalCsvPath));
    File.WriteAllLines(newCsvPath, newLines);

    return newCsvPath;
  }
# ---------- end component_4_path_rating ----------

# ---- group: component group 7: validation-shortest path
crv_12 = Curve([<curve referenced from the Rhino model> x5000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])
crv_13 = Curve(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)
explode = Explode(Curve=crv_13, Recursive=True)  # -> Segments, Vertices
shortwalk = ShortestWalk(Curves=crv_12, WantedPath=explode.Segments)  # -> ShortestWalk, Succession, Direction, Length
panel_4 = Panel(shortwalk.Length)
crv_14 = Curve(shortwalk.ShortestWalk)
col_2 = Colour(RGB(62, 146, 55))

# ---- group: component 1: route generation
pt_2 = Point(Point(-12907.38249, 6710845.435, 0))
pt_3 = Point(Point(-14044.7794, 6712370.277, 0))
component_1_route_generation = CSharpScript(refresh=Toggle(False), roadSegments=crv_5, startPoint=pt_3, endPoint=pt_2, totalLength="6000")  # -> out, startSegmentIndex, waypointsSegmentIndex, endSegmentIndex, formattedRoutes, routeLengths, routeCurves1, routeCurves2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; inputs refresh: Boolean, roadSegments: list of Curve, segmentIndex: Int32, startPoint: Point3d, endPoint: Point3d, waypoints: list of Point3d, totalLength: Double
# ---------- component_1_route_generation: C# usings ----------
using System.Linq;
using Rhino.DocObjects;
using System.Diagnostics;
# ---------- component_1_route_generation: C# ----------
    // Set the maximum runtime to
    const int maxExecutionTimeMs = 300000;

    // Only refresh if the 'refresh' input is set to true
    if (refresh)
    {
      // Store the start point, end point, and waypoints
      storedStartPoint = startPoint;
      storedEndPoint = endPoint;
      storedWaypoints = new List<Point3d>(waypoints);

      // Initialize the connection cache and identify dead-end curves
      List<Curve> deadEndCurvesList;
      Dictionary<Point3d, List<int>> connectionCache = InitializeConnectionCache(roadSegments, out deadEndCurvesList);
      deadEndCurves = deadEndCurvesList;

      // Find the closest road segment to the start and end points
      storedStartSegmentIndex = FindClosestSegmentIndex(roadSegments, storedStartPoint, connectionCache);
      storedEndSegmentIndex = FindClosestSegmentIndex(roadSegments, storedEndPoint, connectionCache);

      startSegmentIndex = storedStartSegmentIndex;
      endSegmentIndex = storedEndSegmentIndex;

      // Clear and then store the segment indices for each waypoint
      storedWaypointsSegmentIndices.Clear();
      foreach (var waypoint in storedWaypoints)
      {
        int waypointSegmentIndex = FindClosestSegmentIndex(roadSegments, waypoint, connectionCache);
        storedWaypointsSegmentIndices.Add(waypointSegmentIndex);
      }

      // Initialize storage for routes, lengths, and errors
      storedRoutes.Clear();
      storedRouteLengths.Clear();
      storedRouteCurves.Clear();
      storedRouteErrors.Clear();
      HashSet<string> previousRoutes = new HashSet<string>();
      int routeCount = 0;
      Stopwatch stopwatch = new Stopwatch();
      stopwatch.Start();  // Start the stopwatch to track execution time

      // Generate up to 10 valid routes
      while (routeCount < 10)
      {
        // Check if the execution time has exceeded the maximum allowed time
        if (stopwatch.ElapsedMilliseconds > maxExecutionTimeMs)
        {
          RhinoApp.WriteLine("Path generation exceeded maximum execution time. Exiting...");
          break;
        }

        RhinoApp.WriteLine(string.Format("Generating route {0}...", routeCount + 1));

        // Generate a segmented route that passes through all waypoints
        var segmentedRoutes = GenerateSegmentedRoute(roadSegments, storedStartPoint, storedWaypoints, storedEndPoint, totalLength, storedStartSegmentIndex, connectionCache, previousRoutes, stopwatch, maxExecutionTimeMs);
        if (segmentedRoutes.Count > 0)
        {
          // Combine all segments into a single route
          List<int> combinedRoute = new List<int>();
          double combinedLength = 0;
          foreach (var segment in segmentedRoutes)
          {
            combinedRoute.AddRange(segment.Item1);
            combinedLength += segment.Item2;
          }

          // Check if the combined route meets all criteria: reaches all waypoints, ends at the destination, and has an acceptable length
          bool reachedAllWaypoints = true;
          foreach (var waypointIndex in storedWaypointsSegmentIndices)
          {
            if (!combinedRoute.Contains(waypointIndex))
            {
              reachedAllWaypoints = false;
              break;
            }
          }

          bool lengthWithinRange = Math.Abs(combinedLength - totalLength) <= totalLength * 0.2;

          if (reachedAllWaypoints && combinedRoute.Last() == storedEndSegmentIndex && lengthWithinRange)
          {
            // Store the valid route, its length, and the corresponding curves
            storedRoutes.Add(combinedRoute);
            storedRouteLengths.Add(combinedLength);

            List<Curve> routeCurveList = new List<Curve>();
            for (int i = 0; i < combinedRoute.Count; i++)
            {
              Curve segment = roadSegments[combinedRoute[i] - 1]; // Adjust index to start from 1
              if (i > 0)
              {
                // Ensure that the segments connect properly
                Point3d prevEnd = routeCurveList[i - 1].PointAtEnd;
                if (segment.PointAtStart.DistanceTo(prevEnd) < segment.PointAtEnd.DistanceTo(prevEnd))
                {
                  segment.Reverse(); // Reverse the curve if needed
                }
              }
              routeCurveList.Add(segment);
            }
            storedRouteCurves.Add(routeCurveList);

            // Calculate the error (difference from the target length) and store it
            double error = Math.Abs(combinedLength - totalLength);
            storedRouteErrors.Add(error);

            routeCount++;
          }
          else
          {
            RhinoApp.WriteLine(string.Format("Route {0} did not meet all criteria, discarding...", routeCount + 1));
          }
        }
        else
        {
          RhinoApp.WriteLine(string.Format("Failed to generate route {0}", routeCount + 1));
        }
      }

      stopwatch.Stop(); // Stop the stopwatch after route generation is done
    }

    // Sort the generated routes based on their error (closeness to target length)
    List<int> sortedIndices = Enumerable.Range(0, storedRouteErrors.Count).ToList();
    sortedIndices.Sort((a, b) => storedRouteErrors[a].CompareTo(storedRouteErrors[b]));

    List<string> sortedFormattedRoutes = new List<string>();
    List<double> sortedRouteLengths = new List<double>();
    List<List<Curve>> sortedRouteCurves = new List<List<Curve>>();

    // Store the top 10 routes (or fewer if less than 10 were generated)
    for (int i = 0; i < Math.Min(10, sortedIndices.Count); i++)
    {
      int index = sortedIndices[i];
      sortedFormattedRoutes.Add(string.Join(" -> ", storedRoutes[index]));
      sortedRouteLengths.Add(storedRouteLengths[index]);
      sortedRouteCurves.Add(storedRouteCurves[index]);
    }

    // Set the output parameters
    formattedRoutes = sortedFormattedRoutes;
    routeLengths = sortedRouteLengths;

    // Set each route curve output, ensuring there are no nulls
    routeCurves1 = sortedRouteCurves.Count > 0 ? sortedRouteCurves[0] : new List<Curve>();
    routeCurves2 = sortedRouteCurves.Count > 1 ? sortedRouteCurves[1] : new List<Curve>();
    routeCurves3 = sortedRouteCurves.Count > 2 ? sortedRouteCurves[2] : new List<Curve>();
    routeCurves4 = sortedRouteCurves.Count > 3 ? sortedRouteCurves[3] : new List<Curve>();
    routeCurves5 = sortedRouteCurves.Count > 4 ? sortedRouteCurves[4] : new List<Curve>();
    routeCurves6 = sortedRouteCurves.Count > 5 ? sortedRouteCurves[5] : new List<Curve>();
    routeCurves7 = sortedRouteCurves.Count > 6 ? sortedRouteCurves[6] : new List<Curve>();
    routeCurves8 = sortedRouteCurves.Count > 7 ? sortedRouteCurves[7] : new List<Curve>();
    routeCurves9 = sortedRouteCurves.Count > 8 ? sortedRouteCurves[8] : new List<Curve>();
    routeCurves10 = sortedRouteCurves.Count > 9 ? sortedRouteCurves[9] : new List<Curve>();
    waypointsSegmentIndex = storedWaypointsSegmentIndices;
    segmentCurve = GetSegmentCurve(roadSegments, segmentIndex);
# ---------- component_1_route_generation: C# additional code ----------
  private List<List<int>> storedRoutes = new List<List<int>>();
  private List<double> storedRouteLengths = new List<double>();
  private List<List<Curve>> storedRouteCurves = new List<List<Curve>>();
  private List<double> storedRouteErrors = new List<double>();
  private List<int> storedWaypointsSegmentIndices = new List<int>();
  private int storedStartSegmentIndex;
  private int storedEndSegmentIndex;
  private Point3d storedStartPoint;
  private Point3d storedEndPoint;
  private List<Point3d> storedWaypoints;

  // Function to get the curve of a specific segment index
  private Curve GetSegmentCurve(List<Curve> roadSegments, int segmentIndex)
  {
    if (segmentIndex < 0 || segmentIndex >= roadSegments.Count)
    {
      return null; // Return null or a special Curve object to indicate an error
    }

    return roadSegments[segmentIndex];
  }

  // Function to initialize the connection cache and identify dead-end curves
  private Dictionary<Point3d, List<int>> InitializeConnectionCache(List<Curve> roadSegments, out List<Curve> deadEndCurves)
  {
    Dictionary<Point3d, List<int>> connectionCache = new Dictionary<Point3d, List<int>>();
    deadEndCurves = new List<Curve>();

    // Build the connection cache
    for (int i = 0; i < roadSegments.Count; i++)
    {
      Curve segment = roadSegments[i];
      Point3d start = segment.PointAtStart;
      Point3d end = segment.PointAtEnd;

      if (!connectionCache.ContainsKey(start))
        connectionCache[start] = new List<int>();
      if (!connectionCache.ContainsKey(end))
        connectionCache[end] = new List<int>();

      connectionCache[start].Add(i + 1);  // Adjust the index to start from 1
      connectionCache[end].Add(i + 1);    // Adjust the index to start from 1
    }

    // Identify dead ends and closed loops
    HashSet<int> deadEndIndices = new HashSet<int>();

    // First pass: Identify dead ends and closed curves
    foreach (var entry in connectionCache)
    {
      Point3d point = entry.Key;
      List<int> connectedSegments = entry.Value;

      if (connectedSegments.Count == 1)
      {
        // Endpoints with only one connection are dead ends
        deadEndIndices.Add(connectedSegments[0]);
      }
      else
      {
        // Check if this point's connected segments are closed curves
        bool allClosedCurves = connectedSegments.All(index => IsClosedCurve(roadSegments[index - 1]));
        if (allClosedCurves)
        {
          foreach (int index in connectedSegments)
          {
            deadEndIndices.Add(index);
          }
        }
      }
    }

    // Second pass: Mark any segment connected to only dead ends as dead ends
    foreach (var entry in connectionCache)
    {
      Point3d point = entry.Key;
      List<int> connectedSegments = entry.Value;

      if (connectedSegments.All(index => deadEndIndices.Contains(index)))
      {
        foreach (int index in connectedSegments)
        {
          deadEndIndices.Add(index);
        }
      }
    }

    // Mark all closed curves as dead ends
    for (int i = 0; i < roadSegments.Count; i++)
    {
      if (IsClosedCurve(roadSegments[i]))
      {
        deadEndIndices.Add(i + 1);  // Adjust the index to start from 1
      }
    }

    // Populate the deadEndCurves list
    foreach (int index in deadEndIndices)
    {
      deadEndCurves.Add(roadSegments[index - 1]);
    }

    // Remove dead ends from connectionCache
    foreach (int index in deadEndIndices)
    {
      Curve segment = roadSegments[index - 1];
      Point3d start = segment.PointAtStart;
      Point3d end = segment.PointAtEnd;

      connectionCache[start].Remove(index);
      connectionCache[end].Remove(index);
    }

    return connectionCache;
  }

  // Check if a curve is closed (forms a loop)
  private bool IsClosedCurve(Curve curve)
  {
    return curve.IsClosed;
  }

  // Generate segmented routes, broken down by waypoints and the final destination
  private List<Tuple<List<int>, double>> GenerateSegmentedRoute(
    List<Curve> roadSegments,
    Point3d startPoint,
    List<Point3d> waypoints,
    Point3d endPoint,
    double totalLength,
    int startSegmentIndex,
    Dictionary<Point3d, List<int>> connectionCache,
    HashSet<string> previousRoutes,
    Stopwatch stopwatch,
    int maxExecutionTimeMs)
  {
    List<Tuple<List<int>, double>> segmentedRoutes = new List<Tuple<List<int>, double>>();
    Point3d currentStartPoint = startPoint;
    int currentStartSegmentIndex = startSegmentIndex;
    List<Point3d> allPoints = new List<Point3d>(waypoints) { endPoint };

    HashSet<int> usedSegments = new HashSet<int>(); // Initialize the set of used segments

    // Handle the waypoints
    foreach (Point3d targetPoint in waypoints)
    {
      if (stopwatch.ElapsedMilliseconds > maxExecutionTimeMs)
      {
        RhinoApp.WriteLine("Segmented route generation exceeded maximum execution time. Exiting...");
        break;
      }

      int currentEndSegmentIndex = FindClosestSegmentIndex(roadSegments, targetPoint, connectionCache);
      var result = GenerateRoute(
        roadSegments, currentStartPoint, targetPoint, totalLength,
        currentStartSegmentIndex, currentEndSegmentIndex, connectionCache,
        previousRoutes, stopwatch, maxExecutionTimeMs, waypoints, usedSegments);

      if (result.Item1.Count > 0)
      {
        segmentedRoutes.Add(result);
        currentStartPoint = targetPoint;
        currentStartSegmentIndex = currentEndSegmentIndex;
      }
      else
      {
        RhinoApp.WriteLine(string.Format("Failed to generate segment from {0} to {1}", currentStartPoint, targetPoint));
        break;
      }
    }

    // Handle the final destination
    if (stopwatch.ElapsedMilliseconds <= maxExecutionTimeMs)
    {
      int endSegmentIndexLocal = FindClosestSegmentIndex(roadSegments, endPoint, connectionCache);
      var result = GenerateRoute(
        roadSegments, currentStartPoint, endPoint, totalLength,
        currentStartSegmentIndex, endSegmentIndexLocal, connectionCache,
        previousRoutes, stopwatch, maxExecutionTimeMs, waypoints, usedSegments);

      if (result.Item1.Count > 0)
      {
        segmentedRoutes.Add(result);
      }
      else
      {
        RhinoApp.WriteLine(string.Format("Failed to generate segment from {0} to {1}", currentStartPoint, endPoint));
      }
    }

    return segmentedRoutes;
  }

  // Generate a single route from the start point to the target point
  private Tuple<List<int>, double> GenerateRoute(
    List<Curve> roadSegments,
    Point3d startPoint,
    Point3d targetPoint,
    double totalLength,
    int startSegmentIndex,
    int endSegmentIndex,
    Dictionary<Point3d, List<int>> connectionCache,
    HashSet<string> previousRoutes,
    Stopwatch stopwatch,
    int maxExecutionTimeMs,
    List<Point3d> waypoints,
    HashSet<int> usedSegments,
    int depth = 0,
    HashSet<int> attemptedRoutes = null)
  {
    const int maxDepth = 40;  // Increase recursion depth limit
    if (depth > maxDepth)
    {
      RhinoApp.WriteLine("Max recursion depth reached");
      return new Tuple<List<int>, double>(new List<int>(), 0);
    }

    if (stopwatch.ElapsedMilliseconds > maxExecutionTimeMs)
    {
      RhinoApp.WriteLine("Route generation exceeded maximum execution time. Exiting...");
      return new Tuple<List<int>, double>(new List<int>(), 0);
    }

    List<int> route = new List<int>();
    double currentLength = 0;
    Point3d currentPoint = startPoint;
    int currentSegmentIndex = startSegmentIndex;

    route.Add(currentSegmentIndex);
    if (attemptedRoutes == null)
    {
      attemptedRoutes = new HashSet<int>();
    }
    attemptedRoutes.Add(currentSegmentIndex);

    Stack<Tuple<Point3d, int, double, HashSet<int>, List<int>, List<int>>> backtrackStack = new Stack<Tuple<Point3d, int, double, HashSet<int>, List<int>, List<int>>>();
    Random rand = new Random();

    while (currentSegmentIndex != endSegmentIndex)
    {
      if (stopwatch.ElapsedMilliseconds > maxExecutionTimeMs)
      {
        RhinoApp.WriteLine("Route generation exceeded maximum execution time during path finding. Exiting...");
        return new Tuple<List<int>, double>(new List<int>(), 0);
      }

      Curve currentSegment = roadSegments[currentSegmentIndex - 1];
      Point3d nextPoint = currentSegment.PointAtStart.Equals(currentPoint) ? currentSegment.PointAtEnd : currentSegment.PointAtStart;
      List<int> connectedSegments = FindConnectedSegments(nextPoint, currentSegmentIndex, connectionCache);

      List<int> availableSegments = connectedSegments.Where(s => !usedSegments.Contains(s)).ToList();

      if (availableSegments.Count == 0)
      {
        while (availableSegments.Count == 0 && backtrackStack.Count > 0)
        {
          usedSegments.Add(currentSegmentIndex);

          var backtrack = backtrackStack.Pop();
          currentPoint = backtrack.Item1;
          currentSegmentIndex = backtrack.Item2;
          currentLength = backtrack.Item3;
          usedSegments = new HashSet<int>(backtrack.Item4);
          route = new List<int>(backtrack.Item5);
          availableSegments = backtrack.Item6;

          RhinoApp.WriteLine("Backtracking... Current Point: " + currentPoint.ToString());
          RhinoApp.WriteLine("Available Segments after Backtracking: " + string.Join(", ", availableSegments));
        }

        if (availableSegments.Count == 0)
        {
          RhinoApp.WriteLine("No way to backtrack, terminating path");
          return new Tuple<List<int>, double>(new List<int>(), 0);
        }
      }

      // Store the current state before moving forward in case backtracking is needed
      backtrackStack.Push(new Tuple<Point3d, int, double, HashSet<int>, List<int>, List<int>>(
        new Point3d(currentPoint.X, currentPoint.Y, currentPoint.Z),
        currentSegmentIndex,
        currentLength,
        new HashSet<int>(usedSegments),
        new List<int>(route),
        new List<int>(availableSegments)
        ));

      // Select the next segment to move forward
      int nextSegmentIndex = SelectNextSegment(availableSegments, roadSegments, currentPoint, targetPoint, rand, currentLength, totalLength);

      // Check for loops or reusing segments
      if (usedSegments.Contains(nextSegmentIndex) || attemptedRoutes.Contains(nextSegmentIndex))
      {
        RhinoApp.WriteLine("Detected loop or reused segment. Restarting route generation...");
        return GenerateRoute(
          roadSegments, startPoint, targetPoint, totalLength,
          startSegmentIndex, endSegmentIndex, connectionCache,
          previousRoutes, stopwatch, maxExecutionTimeMs, waypoints, new HashSet<int>(), depth + 1, new HashSet<int>());
      }

      route.Add(nextSegmentIndex);
      usedSegments.Add(nextSegmentIndex);
      attemptedRoutes.Add(nextSegmentIndex);
      currentSegmentIndex = nextSegmentIndex;
      currentPoint = nextPoint;
      currentLength += roadSegments[nextSegmentIndex - 1].GetLength();
    }

    // Ensure the generated route is unique and not empty
    string routeKey = string.Join("-", route);
    if (previousRoutes.Contains(routeKey) || route.Count == 0)
    {
      if (depth < maxDepth)
      {
        RhinoApp.WriteLine("Retrying route generation due to empty or duplicate route");
        return GenerateRoute(
          roadSegments, startPoint, targetPoint, totalLength,
          startSegmentIndex, endSegmentIndex, connectionCache,
          previousRoutes, stopwatch, maxExecutionTimeMs, waypoints, new HashSet<int>(), depth + 1, new HashSet<int>());
      }
      else
      {
        RhinoApp.WriteLine("Max retry depth reached. Terminating path generation.");
        return new Tuple<List<int>, double>(new List<int>(), 0);
      }
    }

    return new Tuple<List<int>, double>(route, currentLength);
  }

  // Function to select the next segment to move to, based on a combination of angles and randomness
  private int SelectNextSegment(List<int> availableSegments, List<Curve> roadSegments, Point3d currentPoint, Point3d targetPoint, Random rand, double currentLength, double totalLength)
  {
    // Start with a high probability of selecting the segment with the smallest angle
    if (currentLength <= totalLength * 0.5)
    {
      // High probability of selecting the segment with the smallest angle, but retain some randomness
      if (rand.NextDouble() < 0.6) // 60% chance to select the segment with the smallest angle
      {
        return SelectSegmentWithSmallestAngle(roadSegments, availableSegments, currentPoint, targetPoint);
      }
      else
      {
        // 40% chance to select randomly
        return availableSegments[rand.Next(availableSegments.Count)];
      }
    }
    else
    {
      // After the path length exceeds 50%, always select the segment with the smallest angle
      return SelectSegmentWithSmallestAngle(roadSegments, availableSegments, currentPoint, targetPoint);
    }
  }

  // Function to find the segment with the smallest angle relative to the target point
  private int SelectSegmentWithSmallestAngle(List<Curve> roadSegments, List<int> connectedSegments, Point3d currentPoint, Point3d targetPoint)
  {
    double smallestAngle = double.MaxValue;
    int bestSegmentIndex = -1;

    foreach (int segmentIndex in connectedSegments)
    {
      Curve segment = roadSegments[segmentIndex - 1];
      Point3d segmentEndPoint = segment.PointAtStart.Equals(currentPoint) ? segment.PointAtEnd : segment.PointAtStart;
      Vector3d segmentVector = segmentEndPoint - currentPoint;
      Vector3d targetVector = targetPoint - currentPoint;
      double angle = Vector3d.VectorAngle(segmentVector, targetVector);

      if (angle < smallestAngle)
      {
        smallestAngle = angle;
        bestSegmentIndex = segmentIndex;
      }
    }

    return bestSegmentIndex;
  }

  // Function to find the closest segment index to a given point, considering only non-dead-end segments
  private int FindClosestSegmentIndex(List<Curve> segments, Point3d point, Dictionary<Point3d, List<int>> connectionCache)
  {
    double minDistance = double.MaxValue;
    int closestIndex = -1;
    for (int i = 0; i < segments.Count; i++)
    {
      if (!IsDeadEnd(i + 1, connectionCache))  // Adjust index to start from 1
      {
        double t;
        segments[i].ClosestPoint(point, out t);
        Point3d closestPoint = segments[i].PointAt(t);
        double distance = point.DistanceTo(closestPoint);
        if (distance < minDistance)
        {
          minDistance = distance;
          closestIndex = i + 1;  // Adjust index to start from 1
        }
      }
    }
    return closestIndex;
  }

  // Function to determine if a segment is a dead end
  private bool IsDeadEnd(int index, Dictionary<Point3d, List<int>> connectionCache)
  {
    foreach (var entry in connectionCache)
    {
      if (entry.Value.Contains(index) && entry.Value.Count == 1)
      {
        return true;
      }
    }
    return false;
  }

  // Function to find all segments connected to a given point, excluding the current segment
  private List<int> FindConnectedSegments(Point3d point, int excludeIndex, Dictionary<Point3d, List<int>> connectionCache)
  {
    if (connectionCache.ContainsKey(point))
    {
      return connectionCache[point].FindAll(index => index != excludeIndex);
    }
    return new List<int>();
  }

  // Function to get the curves corresponding to a given route (list of segment indices)
  private List<Curve> GetRouteCurves(List<Curve> roadSegments, List<int> route)
  {
    return route.Select(index => roadSegments[index]).ToList();
  }
# ---------- end component_1_route_generation ----------
panel_5 = Panel(component_1_route_generation.routeLengths)
crv_15 = Curve(component_1_route_generation.routeCurves1)
panel_6 = Panel(component_1_route_generation.formattedRoutes)

# ---- group: component group 7: validation-shortest path (continued)
shortest_path_converter = CSharpScript(roadCurves=crv_12, pathCurves=crv_14, extraPoints=[pt_2, pt_3], inputNumbers=panel_4)  # -> out, matchedCurves, curveIDs, totalDistance; inputs roadCurves: list of Curve, pathCurves: list of Curve, extraPoints: list of Point3d, inputNumbers: list of String
# ---------- shortest_path_converter: C# usings ----------
using Rhino.Geometry.Intersect;
using System.Text.RegularExpressions; // 添加这个引用来使用正则表达式相关的类
# ---------- shortest_path_converter: C# ----------
    // Call the encapsulated methods to process the main logic
    double lengthSum = ExtractAndSumNumbers(inputNumbers);
    ProcessCurvesAndPoints(roadCurves, pathCurves, extraPoints, ref lengthSum, ref matchedCurves, ref curveIDs);

    totalDistance = lengthSum; // Output the total length
# ---------- shortest_path_converter: C# additional code ----------
  /// <summary>
  /// Extracts and sums numbers from a list of strings.
  /// </summary>
  private double ExtractAndSumNumbers(List<string> inputs)
  {
    double sum = 0;

    // Iterate through each string in the input list
    foreach (string input in inputs)
    {
      // Use Regex to find all numbers in the string
      MatchCollection matches = Regex.Matches(input, @"[-+]?\d*\.?\d+");
      foreach (Match match in matches)
      {
        double number;
        // Try parsing each matched number string into a double
        if (double.TryParse(match.Value, out number))
        {
          sum += number; // Add the number to the sum
        }
      }
    }

    return sum; // Return the sum of all extracted numbers
  }

  /// <summary>
  /// Processes the curve and point matching logic and updates the matched curves and curve IDs lists.
  /// </summary>
  private void ProcessCurvesAndPoints(List<Curve> roadCurves, List<Curve> pathCurves, List<Point3d> extraPoints, ref double lengthSum, ref object matchedCurves, ref object curveIDs)
  {
    List<Curve> matchedCurvesList = new List<Curve>();
    List<int> matchedCurveIDs = new List<int>();
    HashSet<int> addedCurveIDs = new HashSet<int>();  // To store added curve IDs and avoid duplicates
    double sampleInterval = 3; // Set sampling interval to 3 units

    // Iterate through each curve in the path curves list
    for (int i = 0; i < pathCurves.Count; i++)
    {
      Curve pathCurve = pathCurves[i];
      double pathLength = pathCurve.GetLength();
      int numSamples = (int) (pathLength / sampleInterval);

      // Sample points along the curve
      for (int sampleIndex = 0; sampleIndex <= numSamples; sampleIndex++)
      {
        double parameter = pathCurve.Domain.ParameterAt((double) sampleIndex / numSamples);
        Point3d samplePoint = pathCurve.PointAt(parameter);

        // Find which road curves contain this point
        List<int> matchingCurveIndices = new List<int>();
        for (int j = 0; j < roadCurves.Count; j++)
        {
          Curve roadCurve = roadCurves[j];
          double closestParameter;
          roadCurve.ClosestPoint(samplePoint, out closestParameter);
          Point3d closestPoint = roadCurve.PointAt(closestParameter);
          double distance = samplePoint.DistanceTo(closestPoint);

          if (distance < 0.001) // If the point is very close to the road curve
          {
            matchingCurveIndices.Add(j);
          }
        }

        // If the point matches only one curve segment and that segment hasn't been added, add it
        if (matchingCurveIndices.Count == 1)
        {
          int matchedIndex = matchingCurveIndices[0];
          if (!addedCurveIDs.Contains(matchedIndex + 1))
          {
            matchedCurvesList.Add(roadCurves[matchedIndex]);
            matchedCurveIDs.Add(matchedIndex + 1); // IDs should be 1-based
            addedCurveIDs.Add(matchedIndex + 1); // Add to the set of added IDs
          }
        }
      }
    }

    // Process additional input points
    foreach (Point3d point in extraPoints)
    {
      for (int j = 0; j < roadCurves.Count; j++)
      {
        if (addedCurveIDs.Contains(j + 1))  // Skip if the curve ID has already been added
          continue;

        Curve roadCurve = roadCurves[j];
        double closestParameter;
        roadCurve.ClosestPoint(point, out closestParameter);
        Point3d closestPoint = roadCurve.PointAt(closestParameter);
        double distance = point.DistanceTo(closestPoint);

        if (distance < 0.001) // If the point is very close to the road curve
        {
          matchedCurvesList.Add(roadCurve);
          matchedCurveIDs.Add(j + 1); // IDs should be 1-based
          addedCurveIDs.Add(j + 1); // Add to the set of added IDs

          // Add the length of the curve to the total length
          lengthSum += roadCurve.GetLength();
          break; // Exit the loop after finding a match
        }
      }
    }

    matchedCurves = matchedCurvesList; // Set the output for matched curves
    curveIDs = matchedCurveIDs; // Set the output for matched curve IDs
  }
# ---------- end shortest_path_converter ----------
crv_16 = Curve(shortest_path_converter.matchedCurves)
pipe = Pipe(Curve=crv_16, Radius=Slider(3, range=1..5), Caps=0)
panel_7 = Panel(shortest_path_converter.curveIDs)
panel_8 = Panel(shortest_path_converter.totalDistance)
preview_2 = CustomPreview(Geometry=pipe, Material=col_2)

# ----
multiplication = Multiplication(A="1.5", B=panel_8)
panel_9 = Panel(multiplication)

# ---- group: component 3: space syntax attributes
crv_17 = Curve([<curve referenced from the Rhino model> x5000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])
crv_18 = Curve(component_1_route_generation.routeCurves1)
crv_19 = Curve(component_1_route_generation.routeCurves2)
crv_20 = Curve(component_1_route_generation.routeCurves3)
crv_21 = Curve(component_1_route_generation.routeCurves4)
crv_22 = Curve(component_1_route_generation.routeCurves5)
crv_23 = Curve(component_1_route_generation.routeCurves6)
crv_24 = Curve(component_1_route_generation.routeCurves7)
crv_25 = Curve(component_1_route_generation.routeCurves8)
crv_26 = Curve(component_1_route_generation.routeCurves9)
crv_27 = Curve(component_1_route_generation.routeCurves10)
c_script_3 = CSharpScript(curves=crv_17)  # -> out, A; inputs curves: list of Curve
# ---------- c_script_3: C# usings ----------
using Rhino.Geometry.Intersect;
# ---------- c_script_3: C# ----------
    // 输出的点集合
    List<Point3d> intersectionPoints = new List<Point3d>();
    double tolerance = 0.01;

    // 遍历曲线，找到每一对曲线之间的交点
    for (int i = 0; i < curves.Count; i++)
    {
      for (int j = i + 1; j < curves.Count; j++)
      {
        Curve curve1 = curves[i];
        Curve curve2 = curves[j];

        // 检查曲线是否相交
        CurveIntersections intersections = Rhino.Geometry.Intersect.Intersection.CurveCurve(curve1, curve2, tolerance, tolerance);
        if (intersections != null)
        {
          foreach (IntersectionEvent intersection in intersections)
          {
            Point3d point = intersection.PointA;

            // 检查点是否已经存在
            bool exists = false;
            foreach (Point3d existingPoint in intersectionPoints)
            {
              if (point.DistanceTo(existingPoint) < tolerance)
              {
                exists = true;
                break;
              }
            }

            // 如果点不存在，则添加到点集合中
            if (!exists)
            {
              intersectionPoints.Add(point);
            }
          }
        }
      }
    }

    // 再次检查所有点，确保捕捉到所有曲线的交点，无论它们是两条还是多条曲线的交点
    for (int i = 0; i < intersectionPoints.Count; i++)
    {
      for (int j = i + 1; j < intersectionPoints.Count; j++)
      {
        if (intersectionPoints[i].DistanceTo(intersectionPoints[j]) < tolerance)
        {
          intersectionPoints[j] = intersectionPoints[i]; // 合并点
        }
      }
    }

    // 去重处理，确保最终结果中没有重复点
    HashSet<Point3d> uniquePoints = new HashSet<Point3d>(intersectionPoints, Point3dComparer.Instance);

    // 输出交点
    A = uniquePoints;
# ---------- c_script_3: C# additional code ----------
  class Point3dComparer : IEqualityComparer<Point3d>
  {
    public static readonly Point3dComparer Instance = new Point3dComparer();
    private Point3dComparer() { }

    public bool Equals(Point3d x, Point3d y)
    {
      return x.DistanceTo(y) < 0.01;
    }

    public int GetHashCode(Point3d obj)
    {
      return obj.GetHashCode();
    }
  }
# ---------- end c_script_3 ----------
pt_4 = Point(c_script_3.A)
component_3_space_syntax_attributes = CSharpScript(
    update=Toggle(False),
    nodes=pt_4,
    edges=crv_17,
    Path1=crv_18,
    Path2=crv_19,
    Path3=crv_20,
    Path4=crv_21,
    Path5=crv_22,
    Path6=crv_23,
    Path7=crv_24,
    Path8=crv_25,
    Path9=crv_26,
    Path10=crv_27,
    csv="E:\0141thesis\mapping\PathAttributes.csv",
    pathRanking=component_5_route_recommendation.bestPaths)  # -> out, Path1Nodes, bestPaths; inputs update: Boolean, nodes: list of Point3d, edges: list of Curve, Path1: list of Curve, Path2: list of Curve, Path3: list of Curve, Path4: list of Curve, Path5: list of Curve, Path6: list of Curve, Path7: list of Curve, Path8: list of Curve, Path9: list of Curve, Path10: list of Curve, shortest_path: list of Curve, csv: String, pathRanking: String
# ---------- component_3_space_syntax_attributes: C# ----------
    if (update)
    {
      // Build the graph from nodes and edges
      var graph = BuildGraph(nodes, edges);

      // Calculate connectivity (degree) for each node
      var connectivity = CalculateConnectivity(graph, nodes.Count);

      // Calculate integration and choice for each node
      var integrationChoice = CalculateIntegrationAndChoice(graph, nodes.Count);
      var integration = integrationChoice.Item1;
      var choice = integrationChoice.Item2;

      // Initialize lists to store nodes involved in each path and path statistics
      var allPathNodes = new List<List<Point3d>>();
      var pathStatsList = new List<double[]>();

      // List of all provided paths
      var pathList = new List<List<Curve>> { Path1, Path2, Path3, Path4, Path5, Path6, Path7, Path8, Path9, Path10 };

      // Process each path to identify nodes and calculate stats
      for (int p = 0; p < pathList.Count; p++)
      {
        var pathNodes = IdentifyPathNodes(pathList[p], nodes);
        allPathNodes.Add(pathNodes.ConvertAll(index => nodes[index]));

        var pathStats = CalculatePathStats(pathNodes, connectivity, integration, choice);
        pathStatsList.Add(pathStats);
      }

      // If a shortest path is provided, process it similarly
      if (shortest_path != null && shortest_path.Count > 0)
      {
        var shortestPathNodes = IdentifyPathNodes(shortest_path, nodes);
        allPathNodes.Add(shortestPathNodes.ConvertAll(index => nodes[index]));

        var shortestPathStats = CalculatePathStats(shortestPathNodes, connectivity, integration, choice);
        pathStatsList.Add(shortestPathStats);
      }

      // Update the CSV file with the calculated statistics
      UpdateCsv(csv, pathStatsList, shortest_path != null && shortest_path.Count > 0);

      Path1Nodes = allPathNodes[0];
    }

    // Always execute the path ranking logic
    if (string.IsNullOrEmpty(pathRanking))
    {
      bestPaths = new List<Curve>[0];
    }
    else
    {
      bestPaths = ParsePathRanking(pathRanking, new List<List<Curve>> { Path1, Path2, Path3, Path4, Path5, Path6, Path7, Path8, Path9, Path10 }, shortest_path).SelectMany(x => x).ToList();
    }
# ---------- component_3_space_syntax_attributes: C# additional code ----------
  // Parses the path ranking provided as a string and orders the paths accordingly
  private List<List<Curve>> ParsePathRanking(string pathRanking, List<List<Curve>> paths, List<Curve> shortestPath)
  {
    var rankedPaths = new List<List<Curve>>();
    var pathOrder = new List<int>();

    // Split the ranking string into lines
    var lines = pathRanking.Split(new[] { '\r', '\n' }, StringSplitOptions.RemoveEmptyEntries);
    foreach (var line in lines)
    {
      var parts = line.Split(':');
      if (parts.Length > 0)
      {
        var pathLabel = parts[0].Trim();
        if (pathLabel.StartsWith("Path"))
        {
          int pathIndex;
          if (int.TryParse(pathLabel.Substring(4), out pathIndex))
          {
            pathOrder.Add(pathIndex - 1);  // Convert to zero-based index
          }
        }
        else if (pathLabel == "Shortest Path" && shortestPath != null)
        {
          pathOrder.Add(paths.Count);  // Add shortest path as the last index
        }
      }
    }

    // Add the paths to the ranked list in the specified order
    foreach (var index in pathOrder)
    {
      if (index >= 0 && index < paths.Count)
      {
        rankedPaths.Add(paths[index]);
      }
      else if (index == paths.Count && shortestPath != null)
      {
        rankedPaths.Add(shortestPath);
      }
    }

    return rankedPaths;
  }

  // Builds a graph from the nodes and edges provided
  private Dictionary<int, List<int>> BuildGraph(List<Point3d> nodes, List<Curve> edges)
  {
    var graph = new Dictionary<int, List<int>>();
    for (int i = 0; i < nodes.Count; i++)
      graph[i] = new List<int>();

    // Connect nodes based on the edges
    foreach (var edge in edges)
    {
      int start = FindClosestNode(edge.PointAtStart, nodes);
      int end = FindClosestNode(edge.PointAtEnd, nodes);
      if (start != -1 && end != -1)
      {
        graph[start].Add(end);
        graph[end].Add(start);
      }
    }
    return graph;
  }

  // Calculates the connectivity (degree) for each node in the graph
  private int[] CalculateConnectivity(Dictionary<int, List<int>> graph, int nodeCount)
  {
    var connectivity = new int[nodeCount];
    for (int i = 0; i < nodeCount; i++)
      connectivity[i] = graph[i].Count;
    return connectivity;
  }

  // Calculates integration and choice metrics for the nodes in the graph
  private Tuple<double[], double[]> CalculateIntegrationAndChoice(Dictionary<int, List<int>> graph, int nodeCount)
  {
    var integration = new double[nodeCount];
    var choice = new double[nodeCount];

    for (int i = 0; i < nodeCount; i++)
    {
      var distances = new int[nodeCount];
      var paths = new int[nodeCount];
      var queue = new Queue<int>();
      queue.Enqueue(i);
      distances[i] = 0;
      paths[i] = 1;

      // Breadth-first search to calculate distances and paths
      while (queue.Count > 0)
      {
        int node = queue.Dequeue();
        foreach (int neighbor in graph[node])
        {
          if (paths[neighbor] == 0)
          {
            distances[neighbor] = distances[node] + 1;
            queue.Enqueue(neighbor);
          }
          if (distances[neighbor] == distances[node] + 1)
          {
            paths[neighbor] += paths[node];
            choice[neighbor] += (double) paths[node] / paths[neighbor];
          }
        }
      }

      // Calculate total distance for integration
      int totalDistance = 0;
      for (int j = 0; j < nodeCount; j++)
        totalDistance += distances[j];
      integration[i] = (double) totalDistance / (nodeCount - 1);
    }
    return new Tuple<double[], double[]>(integration, choice);
  }

  // Identifies the nodes that are part of the given path
  private List<int> IdentifyPathNodes(List<Curve> path, List<Point3d> nodes)
  {
    var pathNodes = new List<int>();
    if (path != null)
    {
      foreach (var curve in path)
      {
        int start = FindClosestNode(curve.PointAtStart, nodes);
        int end = FindClosestNode(curve.PointAtEnd, nodes);
        if (start != -1 && !pathNodes.Contains(start))
          pathNodes.Add(start);
        if (end != -1 && !pathNodes.Contains(end))
          pathNodes.Add(end);
      }
    }
    return pathNodes;
  }

  // Calculates statistics like connectivity, integration, and choice for the nodes in a path
  private double[] CalculatePathStats(List<int> pathNodes, int[] connectivity, double[] integration, double[] choice)
  {
    double totalConnectivity = 0;
    double totalIntegration = 0;
    double totalChoice = 0;

    foreach (int node in pathNodes)
    {
      totalConnectivity += connectivity[node];
      totalIntegration += integration[node];
      totalChoice += choice[node];
    }

    int count = pathNodes.Count;
    return new double[] { totalConnectivity / count, totalIntegration / count, totalChoice / count };
  }

  // Updates the CSV file with the calculated statistics for each path
  private void UpdateCsv(string csvPath, List<double[]> pathStatsList, bool hasShortestPath)
  {
    var lines = new List<string>(File.ReadAllLines(csvPath));
    var headers = lines[0].Split(',');
    bool hasConnectivity = Array.Exists(headers, element => element == "Connectivity");
    bool hasIntegration = Array.Exists(headers, element => element == "Integration");
    bool hasChoice = Array.Exists(headers, element => element == "Choice");

    // Add missing columns if necessary
    if (!hasConnectivity) lines[0] += ",Connectivity";
    if (!hasIntegration) lines[0] += ",Integration";
    if (!hasChoice) lines[0] += ",Choice";

    // Update each path's row in the CSV
    for (int i = 1; i < lines.Count; i++)
    {
      var values = new List<string>(lines[i].Split(','));
      string pathLabel = values[0];
      int pathIndex = -1;

      if (pathLabel.StartsWith("Path"))
      {
        pathIndex = int.Parse(pathLabel.Substring(4)) - 1;
      }

      // If the path index is valid, update its statistics
      if (pathIndex >= 0 && pathIndex < pathStatsList.Count && pathStatsList[pathIndex].Length == 3)
      {
        var pathStats = pathStatsList[pathIndex];
        if (!hasConnectivity) values.Add(pathStats[0].ToString("F2"));
        else values[Array.IndexOf(headers, "Connectivity")] = pathStats[0].ToString("F2");

        if (!hasIntegration) values.Add(pathStats[1].ToString("F2"));
        else values[Array.IndexOf(headers, "Integration")] = pathStats[1].ToString("F2");

        if (!hasChoice) values.Add(pathStats[2].ToString("F2"));
        else values[Array.IndexOf(headers, "Choice")] = pathStats[2].ToString("F2");
      }
      lines[i] = string.Join(",", values);
    }

    // Update the shortest path's row in the CSV, if applicable
    if (hasShortestPath)
    {
      var shortestPathStats = pathStatsList[pathStatsList.Count - 1];
      for (int i = 1; i < lines.Count; i++)
      {
        var values = new List<string>(lines[i].Split(','));
        string pathLabel = values[0];
        if (pathLabel == "Shortest Path")
        {
          if (!hasConnectivity) values.Add(shortestPathStats[0].ToString("F2"));
          else values[Array.IndexOf(headers, "Connectivity")] = shortestPathStats[0].ToString("F2");

          if (!hasIntegration) values.Add(shortestPathStats[1].ToString("F2"));
          else values[Array.IndexOf(headers, "Integration")] = shortestPathStats[1].ToString("F2");

          if (!hasChoice) values.Add(shortestPathStats[2].ToString("F2"));
          else values[Array.IndexOf(headers, "Choice")] = shortestPathStats[2].ToString("F2");

          lines[i] = string.Join(",", values);
          break;
        }
      }
    }

    // Save the updated CSV file with a new name
    string newCsvPath = Path.Combine(Path.GetDirectoryName(csvPath), Path.GetFileNameWithoutExtension(csvPath) + "_updated" + Path.GetExtension(csvPath));
    File.WriteAllLines(newCsvPath, lines);
  }

  // Finds the node closest to a given point
  private int FindClosestNode(Point3d point, List<Point3d> nodes)
  {
    double minDist = double.MaxValue;
    int closestNode = -1;
    for (int i = 0; i < nodes.Count; i++)
    {
      double dist = point.DistanceTo(nodes[i]);
      if (dist < minDist)
      {
        minDist = dist;
        closestNode = i;
      }
    }
    return closestNode;
  }
# ---------- end component_3_space_syntax_attributes ----------
crv_28 = Curve(component_3_space_syntax_attributes.bestPaths)

# ---- group: component 2: basic attributes
component_2_basic_attributes = CSharpScript(
    update=Toggle(False),
    formattedRoutes=component_1_route_generation.formattedRoutes,
    csvFilePath="E:\0141thesis\mapping\output.csv")  # -> out, result; inputs update: Boolean, formattedRoutes: list of String, csvFilePath: String, shortest_path: list of String
# ---------- component_2_basic_attributes: C# usings ----------
using System.Data;
using System.IO;
# ---------- component_2_basic_attributes: C# ----------
    // Check if the update button is pressed
    if (!update) return;

    // List of attributes to analyze for each path
    List<string> attributes = new List<string> { "crime", "bench", "step", "ramp", "traffic_light", "no_lighting", "pothole", "restaurant", "bar/pub", "cafe", "bakery", "dessert_store", "food_stall", "market", "Square", "Greenery", "Waterway" };

    // Read the CSV file into a DataTable
    DataTable dataTable = ReadCsvFile(csvFilePath);

    // Initialize a new DataTable to store the results
    DataTable resultTable = new DataTable();
    resultTable.Columns.Add("Path");
    foreach (string attribute in attributes)
    {
      resultTable.Columns.Add(attribute);
    }

    // Calculate the total attribute values for each path
    for (int i = 0; i < formattedRoutes.Count; i++)
    {
      string route = formattedRoutes[i];
      // Parse the route to get segment IDs
      List<int> segmentIds = ParseRoute(route);
      DataRow resultRow = resultTable.NewRow();
      resultRow["Path"] = "Path " + (i + 1).ToString();

      // Sum up the values of each attribute for the current path
      foreach (string attribute in attributes)
      {
        int totalValue = 0;
        foreach (int segmentId in segmentIds)
        {
          // Find the row in the data table corresponding to the current segment ID
          DataRow[] rows = dataTable.Select("ID = " + segmentId);
          if (rows.Length > 0)
          {
            totalValue += Convert.ToInt32(rows[0][attribute]);
          }
        }
        resultRow[attribute] = totalValue;
      }

      // Add the calculated values for the current path to the result table
      resultTable.Rows.Add(resultRow);
    }

    // Handle the shortest path separately if provided
    if (shortest_path != null && shortest_path.Count > 0)
    {
      List<int> segmentIds = ParseRoute(string.Join(" -> ", shortest_path));
      DataRow resultRow = resultTable.NewRow();
      resultRow["Path"] = "Shortest Path";

      // Sum up the values of each attribute for the shortest path
      foreach (string attribute in attributes)
      {
        int totalValue = 0;
        foreach (int segmentId in segmentIds)
        {
          DataRow[] rows = dataTable.Select("ID = " + segmentId);
          if (rows.Length > 0)
          {
            totalValue += Convert.ToInt32(rows[0][attribute]);
          }
        }
        resultRow[attribute] = totalValue;
      }

      // Add the calculated values for the shortest path to the result table
      resultTable.Rows.Add(resultRow);
    }

    // Export the new CSV file with the calculated path attributes
    string outputFilePath = Path.Combine(Path.GetDirectoryName(csvFilePath), "PathAttributes.csv");
    WriteCsvFile(outputFilePath, resultTable);
    result = outputFilePath;
# ---------- component_2_basic_attributes: C# additional code ----------
  // Function to parse the route string and extract segment IDs
  private List<int> ParseRoute(string route)
  {
    List<int> segmentIds = new List<int>();
    string[] segments = route.Split(new string[] { " -> " }, StringSplitOptions.None);
    foreach (string segment in segments)
    {
      int segmentId;
      if (int.TryParse(segment, out segmentId))
      {
        segmentIds.Add(segmentId);
      }
    }
    return segmentIds;
  }

  // Function to read the CSV file and load it into a DataTable
  private DataTable ReadCsvFile(string filePath)
  {
    DataTable dataTable = new DataTable();
    using (StreamReader sr = new StreamReader(filePath))
    {
      // Read the header row
      string[] headers = sr.ReadLine().Split(',');
      foreach (string header in headers)
      {
        dataTable.Columns.Add(header);
      }

      // Read the rest of the data
      while (!sr.EndOfStream)
      {
        string[] rows = sr.ReadLine().Split(',');
        DataRow dataRow = dataTable.NewRow();
        for (int i = 0; i < headers.Length; i++)
        {
          dataRow[i] = rows[i];
        }
        dataTable.Rows.Add(dataRow);
      }
    }
    return dataTable;
  }

  // Function to write the DataTable back to a CSV file
  private void WriteCsvFile(string filePath, DataTable dataTable)
  {
    using (StreamWriter sw = new StreamWriter(filePath))
    {
      // Write the column names
      string[] columnNames = new string[dataTable.Columns.Count];
      for (int i = 0; i < dataTable.Columns.Count; i++)
      {
        columnNames[i] = dataTable.Columns[i].ColumnName;
      }
      sw.WriteLine(string.Join(",", columnNames));

      // Write the data rows
      foreach (DataRow row in dataTable.Rows)
      {
        string[] fields = new string[dataTable.Columns.Count];
        for (int i = 0; i < dataTable.Columns.Count; i++)
        {
          fields[i] = row[i].ToString();
        }
        sw.WriteLine(string.Join(",", fields));
      }
    }
  }
# ---------- end component_2_basic_attributes ----------

# ----
cluster = Cluster(curve=crv_15, list_2=crv_15, list=crv_15)  # -> vector, i, arithmetic_mean, series_2, number_slider

# ---- group: component 1: route generation (continued)
vdis = VectorDisplay(Anchor=cluster.i, Vector=cluster.vector)
tag = TextTag3D(Location=flatten(cluster.arithmetic_mean), Text=cluster.series_2, Size=cluster.number_slider, Justification=7)

# ---- group: component 6: visualization
list = ValueList({"Top1": 0, "Top2": 1, "Top3": 2, "Top4": 3, "Top5": 4, "Top6": 5, "Top7": 6, "Top8": 7, "Top9": 8, "Top10": 9, "Top11": 10}, selected="Top1")
bang = ExplodeTree(Data=crv_28)  # -> Branch0, Branch1, Branch2, Branch3, Branch4, Branch5, Branch6, Branch7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
filter = StreamFilter(
    Gate=list,
    Stream0=bang.Branch0,
    Stream1=bang.Branch1,
    Stream2=bang.Branch2,
    Stream3=bang.Branch3,
    Stream4=bang.Branch4,
    Stream5=bang.Branch5,
    Stream6=bang.Branch6,
    Stream7=bang.Branch7,
    Stream8=bang.Branch8,
    Stream9=bang.Branch9,
    Stream10=bang.Branch10)
crv_29 = Curve(filter)
gradient = Gradient(LowerLimit=0, UpperLimit="10", Parameter=list, stops=[0: RGB(220, 20, 60), 0.5: RGB(159, 65, 29), 1: RGB(0, 0, 0)])
lng = ListLength(List=crv_29)
pipe_2 = Pipe(Curve=crv_29, Radius=Slider(3, range=1..5), Caps=0)
cp = ControlPoints(Curve=crv_29)  # -> Points, Weights, Knots
item = ListItem(List=crv_29, Index=Slider(24, range=0..100), Wrap=True)
lng_2 = ListLength(List=cp.Points)
series = Series(Start=0, Step=1, Count=lng)
subtraction = Subtraction(A=lng_2, B="1")
item_2 = ListItem(List=cp.Points, Index=Slider(0, range=0..100), Wrap=True)
item_3 = ListItem(List=cp.Points, Index=subtraction, Wrap=True)
avr = Average(Input=[item_2, item_3])
vec2pt = Vector2Pt(PointA=item_3, PointB=item_2, Unitize=False)  # -> Vector, Length
amp = Amplitude(Vector=vec2pt.Vector, Amplitude=Slider(1, range=0..10))
tag_2 = TextTag3D(Location=flatten(avr), Text=series, Size=Slider(11, range=0..20), Colour=gradient, Justification=7)
preview_3 = CustomPreview(Geometry=pipe_2, Material=gradient)
vdis_2 = VectorDisplay(Anchor=item_2, Vector=amp)

# ==== cluster Cluster
list = ClusterInput()
curve = ClusterInput()
list_length = ListLength(List=list)
list_2 = ClusterInput()
control_points = ControlPoints(Curve=curve)  # -> Points, Weights, Knots
list_item = ListItem(List=list_2, Index=Slider(32, range=0..100), Wrap=True)
list_length_2 = ListLength(List=control_points.Points)
series = Series(Start=0, Step=1, Count=list_length)
subtraction = Subtraction(A=list_length_2, B=Slider(1, range=0..1))
series_2 = ClusterOutput(series)
list_item_2 = ListItem(List=control_points.Points, Index=Slider(0, range=0..100), Wrap=True)
list_item_3 = ListItem(List=control_points.Points, Index=subtraction, Wrap=True)
average = Average(Input=[list_item_2, list_item_3])
i = ClusterOutput(list_item_2)
vector_2pt = Vector2Pt(PointA=list_item_3, PointB=list_item_2, Unitize=False)  # -> Vector, Length
arithmetic_mean = ClusterOutput(average)
number_slider = ClusterOutput(Slider(8, range=0..10))
amplitude = Amplitude(Vector=vector_2pt.Vector, Amplitude=Slider(2, range=0..10))
vector = ClusterOutput(amplitude)
